# Grasshopper definition Lewis_Final_Iteration 2.gh (Grasshopper 1.0.7)
# plug-ins: Bifocals

# ----
# 1:GRID SIZE
number_slider = Slider(26, range=0..30)
u1 = GetInteger(number_slider, AtLeast=1, AtMost=1, Maximum=2147483647, Minimum=-2147483648)
v1 = GetInteger(Slider(23, range=0..30), AtLeast=1, AtMost=1, Maximum=2147483647, Minimum=-2147483648)

# ----
# site
curve = Curve([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])
surface = Surface(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)

custom_preview = CustomPreview(Geometry=surface, Material=ColourSwatch(SwatchColor=RGBA(160, 255, 255, 139)))
custom_preview_2 = CustomPreview(Geometry=curve, Material=ColourSwatch(SwatchColor=RGB(255, 255, 0)))

# ----
# 2: PLOT SIZE
number_slider_2 = Slider(30, range=0..100)
x2 = GetInteger(Slider(29, range=0..100), AtLeast=1, AtMost=1, Maximum=2147483647, Minimum=-2147483648)
y2 = GetInteger(number_slider_2, AtLeast=1, AtMost=1, Maximum=2147483647, Minimum=-2147483648)

# ----
# 3: BUILD SIZE
number_slider_3 = Slider(16, range=0..100)
y3 = GetInteger(number_slider_3, AtLeast=1, AtMost=1, Maximum=2147483647, Minimum=-2147483648)
x3 = GetInteger(Slider(17, range=0..100), AtLeast=1, AtMost=1, Maximum=2147483647, Minimum=-2147483648)

surface_2 = Surface(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)
divide_surface = DivideSurface(Surface=surface_2, UCount=u1, VCount=v1)  # -> Points, Normals, Parameters

# ----
# 5:STREET OFFSET
number_slider_4 = Slider(100, range=0..200)
street_width = GetNumber(number_slider_4, AtLeast=1, AtMost=1, Maximum=1.797693135e+308, Minimum=-1.797693135e+308)

# ----
# 4: 1 OR 2 LEVELS
number_slider_5 = Slider(1, range=0..1)
panel = Panel("""3.5
7.0""")

z4 = GetInteger(number_slider_5, AtLeast=1, AtMost=1, Maximum=2147483647, Minimum=-2147483648)

list_item = ListItem(List=panel, Index=z4, Wrap=True)

center_box = CenterBox(Base=divide_surface.Points, X=expr("x/2", x3), Y=expr("x/2", y3), Z=list_item)
box_properties = BoxProperties(Box=center_box)  # -> Center, Diagonal, Area, Volume, Degeneracy

# ----
# side streets
point = Point([Point(-129.6282009, 531.6482688, 84.03962914), Point(-127.7426432, 465.0127856, 84.48211141), Point(-128.7964455, 415.2095498, 82.28880564)])
point_2 = Point([Point(-128.7964455, 395.8241336, 82.28880564), Point(-129.3454324, 347.7312572, 88.2181795), Point(-129.6561029, 324.104573, 91.26488288)])
point_3 = Point([Point(-206.0640737, 394.355608, 78.25262892), Point(-206.0925222, 456.2845955, 80.68665981), Point(-205.8333553, 506.5383455, 77.11138669)])
point_4 = Point([Point(-212.5985113, 383.0766191, 79.37707649), Point(-212.5995669, 305.7404939, 76.97027354), Point(-204.8393777, 244.2966827, 78.79521744)])
point_5 = Point([Point(-298.6285622, 401.9479797, 76.67913028), Point(-299.6698545, 471.7920198, 72.54611533), Point(-299.38359, 544.9133298, 69.97369503)])
point_6 = Point([Point(-298.375619, 394.3989515, 76.67913028), Point(-299.341654, 350.0605729, 75.56653507), Point(-298.6887456, 247.5892287, 74.30788444)])
point_7 = Point([Point(-380.8696942, 436.9876486, 61.28819442), Point(-382.3974888, 483.2217507, 61.78721024), Point(-384.6251144, 533.7358101, 66.33602911)])
point_8 = Point([Point(-383.5322548, 431.3054779, 61.28819442), Point(-383.4586067, 349.7775473, 62.91633995), Point(-384.1729629, 276.9349497, 70.54822919)])
point_9 = Point([Point(-464.0638294, 430.6526819, 55.4925267), Point(-461.4876155, 463.6242209, 55.69875274), Point(-464.9382941, 536.4861703, 57.50574618)])
point_10 = Point([Point(-462.6573453, 421.3499929, 56.30383579), Point(-468.4571489, 349.5265329, 56.64110239), Point(-468.1367649, 283.4080617, 56.56173489)])

street_a_1 = GetPoint(point, AtLeast=1, AtMost=1, Realtime=True)
street_a_2 = GetPoint(point_2, AtLeast=1, AtMost=1, Realtime=True)
street_b_1 = GetPoint(point_3, AtLeast=1, AtMost=1, Realtime=True)
street_b_2 = GetPoint(point_4, AtLeast=1, AtMost=1, Realtime=True)
street_c_1 = GetPoint(point_5, AtLeast=1, AtMost=1, Realtime=True)
street_c_2 = GetPoint(point_6, AtLeast=1, AtMost=1, Realtime=True)
street_d_1 = GetPoint(point_7, AtLeast=1, AtMost=1, Realtime=True)
street_d_2 = GetPoint(point_8, AtLeast=1, AtMost=1, Realtime=True)
street_e_1 = GetPoint(point_9, AtLeast=1, AtMost=1, Realtime=True)
street_e_2 = GetPoint(point_10, AtLeast=1, AtMost=1, Realtime=True)

interpolate = Interpolate(Vertices=street_a_1, Degree=3, Periodic=False, KnotStyle=1)  # -> Curve, Length, Domain
interpolate_2 = Interpolate(Vertices=street_a_2, Degree=3, Periodic=False, KnotStyle=1)  # -> Curve, Length, Domain
interpolate_3 = Interpolate(Vertices=street_b_2, Degree=3, Periodic=False, KnotStyle=1)  # -> Curve, Length, Domain
interpolate_4 = Interpolate(Vertices=street_b_1, Degree=3, Periodic=False, KnotStyle=1)  # -> Curve, Length, Domain
curve_2 = Curve(interpolate.Curve)
curve_3 = Curve(interpolate_2.Curve)
curve_4 = Curve(interpolate_3.Curve)
curve_5 = Curve(interpolate_4.Curve)
interpolate_5 = Interpolate(Vertices=street_c_1, Degree=3, Periodic=False, KnotStyle=1)  # -> Curve, Length, Domain
interpolate_6 = Interpolate(Vertices=street_c_2, Degree=3, Periodic=False, KnotStyle=1)  # -> Curve, Length, Domain
curve_6 = Curve(interpolate_5.Curve)
interpolate_7 = Interpolate(Vertices=street_d_1, Degree=3, Periodic=False, KnotStyle=1)  # -> Curve, Length, Domain
curve_7 = Curve(interpolate_6.Curve)
curve_8 = Curve(interpolate_7.Curve)
interpolate_8 = Interpolate(Vertices=street_d_2, Degree=3, Periodic=False, KnotStyle=1)  # -> Curve, Length, Domain
curve_9 = Curve(interpolate_8.Curve)
# main street
interpolate_9 = Interpolate(Vertices=street_e_1, Degree=3, Periodic=False, KnotStyle=1)  # -> Curve, Length, Domain
curve_10 = Curve(interpolate_9.Curve)
interpolate_10 = Interpolate(Vertices=street_e_2, Degree=3, Periodic=False, KnotStyle=1)  # -> Curve, Length, Domain
# side streets
curve_11 = Curve(interpolate_10.Curve)

merge = Merge(
    Data1=curve_2,
    Data2=curve_3,
    Data3=curve_5,
    Data4=curve_4,
    Data5=curve_6,
    Data6=curve_7,
    Data7=curve_8,
    Data8=curve_9,
    Data9=curve_10,
    Data10=curve_11)

# ----
# side streets
xy_plane = XYPlane(Origin=Point(0, 0, 0))
xy_plane_2 = XYPlane(Origin=Point(0, 0, 0))
offset_curve = OffsetCurve(Curve=merge, Distance="3", Plane=xy_plane, Corners=1)
offset_curve_2 = OffsetCurve(Curve=merge, Distance="-3", Plane=xy_plane_2, Corners=1)
loft = Loft(
    Curves=[offset_curve_2, offset_curve],
    Options={Adjust=False, Closed=False, LoftEnds=0, LoftSimp=0, LoftType=0, Rebuild=10, Refit=0.01})

c_script = CSharpScript(crv=[offset_curve, offset_curve_2], color=ColourSwatch(SwatchColor=RGB(255, 162, 0)))  # -> out, A; inputs crv: Curve, color: Color
# ---------- c_script: C# ----------
    var c = color.R + "," + color.G + "," + color.B;
    crv.SetUserString("color", c);
    A = crv;
# ---------- end c_script ----------
curve_12 = Curve(flatten(c_script.A))

# ----
# main street
# main street
point_11 = Point([Point(-526.8155641, 462.7705244, 48.44430821), Point(-448.1377837, 424.9144948, 58.01753433), Point(-369.9919382, 429.7790393, 63.29763913), Point(-251.0783147, 383.6454627, 78.19858019), Point(-171.456714, 388.8526341, 80.37471289), Point(-88.23105536, 404.2113826, 94.04884817)])

street_main = GetPoint(point_11, AtLeast=1, AtMost=1, Realtime=True)

interpolate_11 = Interpolate(Vertices=street_main, Degree=3, Periodic=False, KnotStyle=1)  # -> Curve, Length, Domain
curve_13 = Curve(interpolate_11.Curve)

# ----
# side streets
# main street
# main street
merge_2 = Merge(
    Data1=curve_13,
    Data2=curve_10,
    Data3=curve_11,
    Data4=curve_6,
    Data5=curve_7,
    Data6=curve_8,
    Data7=curve_9,
    Data8=curve_2,
    Data9=curve_3,
    Data10=curve_5,
    Data11=curve_4)
# 5:STREET OFFSET
pull_point = PullPoint(Point=box_properties.Center, Geometry=merge_2, ClosestOnly=True)  # -> ClosestPoint, Distance
larger_than = LargerThan(FirstNumber=pull_point.Distance, SecondNumber=street_width)  # -> LargerThan, OrEqualTo
cull_pattern = CullPattern(List=center_box, CullPattern=invert(larger_than.LargerThan))
brep_wireframe = BrepWireframe(Brep=cull_pattern, Density=-1)
volume = Volume(Geometry=cull_pattern)  # -> Volume, Centroid
cull_pattern_2 = CullPattern(List=center_box, CullPattern=larger_than.LargerThan)
pull_point_2 = PullPoint(Point=volume.Centroid, Geometry=merge_2, ClosestOnly=True)  # -> ClosestPoint, Distance
panel_2 = Panel(cull_pattern_2)
vector_2pt = Vector2Pt(PointA=pull_point_2.ClosestPoint, PointB=volume.Centroid, Unitize=False)  # -> Vector, Length
vector_display = VectorDisplay(Anchor=pull_point_2.ClosestPoint, Vector=vector_2pt.Vector)
amplitude = Amplitude(Vector=vector_2pt.Vector, Amplitude=Slider(5.1, range=0..100))
move = Move(Geometry=cull_pattern, Motion=amplitude)  # -> Geometry, Transform
# side streets
box_properties_2 = BoxProperties(Box=move.Geometry)  # -> Center, Diagonal, Area, Volume, Degeneracy
center_box_2 = CenterBox(Base=box_properties_2.Center, X=expr("X/2", x2), Y=expr("X/2", y2), Z="0")
mesh_brep = MeshBrep(
    Brep=center_box_2,
    Settings={GridMaxCount=0, GridMinCount=16, JaggedSeams=False, MaxEdgeLength=0, MinEdgeLength=0.0001, MinTolerance=0, Refine=True, RefineAngle=0, RelativeTolerance=0.65, SimplePlanes=True, Tolerance=0})
split_brep = SplitBrep(Brep=move.Geometry, Cutter=center_box_2)
mesh_colours = MeshColours(Mesh=mesh_brep, Colours=ColourSwatch(SwatchColor=RGB(0, 206, 96)))
list_item_2 = ListItem(List=split_brep, Index=0, Wrap=True)
mesh = Mesh(mesh_colours)
mesh_brep_2 = MeshBrep(
    Brep=list_item_2,
    Settings={GridMaxCount=0, GridMinCount=16, JaggedSeams=False, MaxEdgeLength=0, MinEdgeLength=0.0001, MinTolerance=0, Refine=True, RefineAngle=0, RelativeTolerance=0.65, SimplePlanes=True, Tolerance=0})
mesh_colours_2 = MeshColours(Mesh=mesh_brep_2, Colours=[ColourSwatch(SwatchColor=RGB(255, 255, 255)), ColourSwatch(SwatchColor=RGB(109, 136, 255))])
mesh_2 = Mesh(mesh_colours_2)

# ----
# main street
xy_plane_3 = XYPlane(Origin=Point(0, 0, 0))
xy_plane_4 = XYPlane(Origin=Point(0, 0, 0))
offset_curve_3 = OffsetCurve(Curve=curve_13, Distance="3.5", Plane=xy_plane_3, Corners=1)
offset_curve_4 = OffsetCurve(Curve=curve_13, Distance="-3.5", Plane=xy_plane_4, Corners=1)
loft_2 = Loft(
    Curves=[offset_curve_4, offset_curve_3],
    Options={Adjust=False, Closed=False, LoftEnds=0, LoftSimp=0, LoftType=0, Rebuild=10, Refit=0.01})

c_script_2 = CSharpScript(crv=[offset_curve_4, offset_curve_3], color=ColourSwatch(SwatchColor=RGB(255, 0, 123)))  # -> out, A; inputs crv: Curve, color: Color; same code as c_script
curve_14 = Curve(flatten(c_script_2.A))
