# Grasshopper definition Lewis_Final_Iteration 3.gh (Grasshopper 1.0.7)
# plug-ins: Bifocals

# site: street
curve = Curve(flatten([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]))
# site: mountain
surface = Surface(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)

# ----
# 4: 1 OR 2 LEVELS
number_slider = Slider(0, range=0..2)
panel = Panel("""3.5
7.0
10.0""")
z4 = GetInteger(number_slider, AtLeast=1, AtMost=1, Maximum=2147483647, Minimum=-2147483648)
list_item = ListItem(List=panel, Index=z4, Wrap=True)

# ----
# 3: BUILD SIZE
number_slider_2 = Slider(16, range=0..100)
y3 = GetInteger(number_slider_2, AtLeast=1, AtMost=1, Maximum=2147483647, Minimum=-2147483648)
x3 = GetInteger(Slider(17, range=0..100), AtLeast=1, AtMost=1, Maximum=2147483647, Minimum=-2147483648)

# ----
# 1:GRID SIZE
number_slider_3 = Slider(26, range=0..30)
u1 = GetInteger(number_slider_3, AtLeast=1, AtMost=1, Maximum=2147483647, Minimum=-2147483648)
v1 = GetInteger(Slider(23, range=0..30), AtLeast=1, AtMost=1, Maximum=2147483647, Minimum=-2147483648)

# ----
# 2: PLOT SIZE
number_slider_4 = Slider(30, range=0..100)
x2 = GetInteger(Slider(29, range=0..100), AtLeast=1, AtMost=1, Maximum=2147483647, Minimum=-2147483648)
y2 = GetInteger(number_slider_4, AtLeast=1, AtMost=1, Maximum=2147483647, Minimum=-2147483648)

mesh_brep = MeshBrep(
    Brep=surface,
    Settings={GridMaxCount=0, GridMinCount=16, JaggedSeams=False, MaxEdgeLength=0, MinEdgeLength=0.0001, MinTolerance=0, Refine=True, RefineAngle=0, RelativeTolerance=0.65, SimplePlanes=True, Tolerance=0})
c_script = CSharpScript(crv=curve, color=ColourSwatch(SwatchColor=RGB(255, 255, 0)))  # -> out, A; inputs crv: Curve, color: Color
# ---------- c_script: C# ----------
    var c = color.R + "," + color.G + "," + color.B;
    crv.SetUserString("color", c);
    A = crv;
# ---------- end c_script ----------
mesh_colours = MeshColours(Mesh=mesh_brep, Colours=ColourSwatch(SwatchColor=RGBA(160, 255, 255, 139)))

# ---- group: RH_OUT:contextcrv
curve_2 = Curve(flatten(c_script.A))

# ---- group: RH_OUT:contextlrg
mesh = Mesh(flatten(mesh_colours))

# ----
surface_2 = Surface(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)
mesh_brep_2 = MeshBrep(
    Brep=surface_2,
    Settings={GridMaxCount=0, GridMinCount=16, JaggedSeams=False, MaxEdgeLength=0, MinEdgeLength=0.0001, MinTolerance=0, Refine=True, RefineAngle=0, RelativeTolerance=0.65, SimplePlanes=True, Tolerance=0})
mesh_colours_2 = MeshColours(Mesh=mesh_brep_2, Colours=ColourSwatch(SwatchColor=RGB(160, 255, 255)))
divide_surface = DivideSurface(Surface=surface_2, UCount=u1, VCount=v1)  # -> Points, Normals, Parameters

# ---- group: RH_OUT:contextsm
mesh_2 = Mesh(flatten(mesh_colours_2))

# ----
center_box = CenterBox(Base=divide_surface.Points, X=expr("x/2", x3), Y=expr("x/2", y3), Z=list_item)
box_properties = BoxProperties(Box=center_box)  # -> Center, Diagonal, Area, Volume, Degeneracy

# ----
# 5:STREET OFFSET
number_slider_5 = Slider(200, range=0..200)

colour_swatch = ColourSwatch(SwatchColor=RGB(0, 206, 96))
colour_swatch_2 = ColourSwatch(SwatchColor=RGB(255, 0, 123))

# ----
# main street
point = Point([Point(-530.3917067, 402.9468872, 48.43865394), Point(-413.0970525, 403.3202454, 59.4694493), Point(-337.5148297, 386.0217173, 70.03374653), Point(-262.2166202, 389.578857, 78.41490675), Point(-181.4282557, 425.8121123, 81.17971427), Point(-88.49971179, 404.486262, 93.93242447)])

get_point = GetPoint(point, AtLeast=1, AtMost=1, Realtime=True)

interpolate = Interpolate(Vertices=get_point, Degree=3, Periodic=False, KnotStyle=1)  # -> Curve, Length, Domain
curve_3 = Curve(interpolate.Curve)

pull_point = PullPoint(Point=box_properties.Center, Geometry=curve_3, ClosestOnly=True)  # -> ClosestPoint, Distance
larger_than = LargerThan(FirstNumber=pull_point.Distance, SecondNumber=number_slider_5)  # -> LargerThan, OrEqualTo
cull_pattern = CullPattern(List=center_box, CullPattern=invert(larger_than.LargerThan))

# ----
# main street
xy_plane = XYPlane(Origin=Point(0, 0, 0))
xy_plane_2 = XYPlane(Origin=Point(0, 0, 0))
offset_curve = OffsetCurve(Curve=curve_3, Distance="3.5", Plane=xy_plane, Corners=1)
offset_curve_2 = OffsetCurve(Curve=curve_3, Distance="-3.5", Plane=xy_plane_2, Corners=1)
loft = Loft(
    Curves=[offset_curve_2, offset_curve],
    Options={Adjust=False, Closed=False, LoftEnds=0, LoftSimp=0, LoftType=0, Rebuild=10, Refit=0.01})

brep_wireframe = BrepWireframe(Brep=cull_pattern, Density=-1)
volume = Volume(Geometry=cull_pattern)  # -> Volume, Centroid
cull_pattern_2 = CullPattern(List=center_box, CullPattern=larger_than.LargerThan)
pull_point_2 = PullPoint(Point=volume.Centroid, Geometry=curve_3, ClosestOnly=True)  # -> ClosestPoint, Distance
panel_2 = Panel(cull_pattern_2)
vector_2pt = Vector2Pt(PointA=pull_point_2.ClosestPoint, PointB=volume.Centroid, Unitize=False)  # -> Vector, Length
vector_display = VectorDisplay(Anchor=pull_point_2.ClosestPoint, Vector=vector_2pt.Vector)
amplitude = Amplitude(Vector=vector_2pt.Vector, Amplitude=Slider(5.1, range=0..100))
move = Move(Geometry=cull_pattern, Motion=amplitude)  # -> Geometry, Transform
box_properties_2 = BoxProperties(Box=move.Geometry)  # -> Center, Diagonal, Area, Volume, Degeneracy
center_box_2 = CenterBox(Base=box_properties_2.Center, X=expr("X/2", x2), Y=expr("X/2", y2), Z="0")
mesh_brep_3 = MeshBrep(
    Brep=center_box_2,
    Settings={GridMaxCount=0, GridMinCount=16, JaggedSeams=False, MaxEdgeLength=0, MinEdgeLength=0.0001, MinTolerance=0, Refine=True, RefineAngle=0, RelativeTolerance=0.65, SimplePlanes=True, Tolerance=0})
split_brep = SplitBrep(Brep=move.Geometry, Cutter=center_box_2)
mesh_colours_3 = MeshColours(Mesh=mesh_brep_3, Colours=ColourSwatch(SwatchColor=RGB(0, 206, 96)))
list_item_2 = ListItem(List=split_brep, Index=0, Wrap=True)

# ---- group: RH_OUT:plot
mesh_3 = Mesh(flatten(mesh_colours_3))

# ----
mesh_brep_4 = MeshBrep(
    Brep=list_item_2,
    Settings={GridMaxCount=0, GridMinCount=16, JaggedSeams=False, MaxEdgeLength=0, MinEdgeLength=0.0001, MinTolerance=0, Refine=True, RefineAngle=0, RelativeTolerance=0.65, SimplePlanes=True, Tolerance=0})
mesh_brep_5 = MeshBrep(
    Brep=loft,
    Settings={GridMaxCount=0, GridMinCount=16, JaggedSeams=False, MaxEdgeLength=0, MinEdgeLength=0.0001, MinTolerance=0, Refine=True, RefineAngle=0, RelativeTolerance=0.65, SimplePlanes=True, Tolerance=0})
c_script_2 = CSharpScript(crv=[offset_curve_2, offset_curve], color=ColourSwatch(SwatchColor=RGB(255, 255, 0)))  # -> out, A; inputs crv: Curve, color: Color; same code as c_script

# ---- group: RH_OUT:mainstr
rh_out_maincrv = Curve(flatten(c_script_2.A))

# ----
mesh_colours_4 = MeshColours(Mesh=mesh_brep_5, Colours=colour_swatch_2)
mesh_colours_5 = MeshColours(
    Mesh=mesh_brep_4,
    Colours=[ColourSwatch(SwatchColor=RGB(255, 255, 255)), ColourSwatch(SwatchColor=RGB(109, 136, 255)), colour_swatch_2])

# ---- group: RH_OUT:mainstsrf
# side streets
# side streets
# main street
# main street
mesh_4 = Mesh(flatten(mesh_colours_4))

# ---- group: RH_OUT:building
mesh_5 = Mesh(flatten(mesh_colours_5))
